vi "Gerador de sinais.gviweb"   [LabVIEW NXG 5.0.0]
panel controls:
  "Amplitude": f64 = 5
  "Tempo": f64 = 1
  "Forma de onda": T1 = "Senoidal"
  "Offset": f64
  "Fase": f64
  "Frequência": f64 = 1
  "Razão cíclica": f64 = 50
  "Concatenar": bool
  "Concatenar entre cursores": bool
  "Deletar entre cursores": bool
  "Adquirir entre cursores": bool
panel indicators:
  "URL Image": string
  "Waveform Graph": waveform<f64>
  "String Constant": string
  "Waveform Graph_2": waveform<f64>
  "error out": error
  "Comando de edição": i32
  "resulting string": string
  "value": cluster{"Y": f64[], "dt": f64}
types:
  T1 = enum{"Senoidal", "Triangular", "Quadrada", "Dente de Serra", "Trapezoidal"}
  T2 = cluster{"Sinal": string, "Fase": f64, "Offset": f64, "Tempo": f64, "Amplitude": f64, "Frequência": f64, "Razão cíclica": f64, "Comando de edição": i32, "Posição cursor 0": f64, "Posição cursor 1": f64}
uses:
  NI::HTTP::Open HTTP Handle.gvi
  WebApp::Conversor ENUM para ARRAY.gviweb
  WebApp::Function_2.gviweb
  NI::HTTP::GET.gvi
  WebApp::Posição cursores.gviweb
  NI::HTTP::Close HTTP Handle.gvi
diagram:
  w1 = T2 {"Tempo"=1, "Amplitude"=5, "Frequência"=1, "Razão cíclica"=50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}
  w2 = "Inicialização"  # Type
  call "Open HTTP Handle.gvi"() -> (client handle out=w3, error out=w4)
  s1 = w2  # shift register
  s2 = w1  # shift register
  s3 = w4  # shift register
  s4 = w3  # shift register
  while {
    case (s1) {
      frame "Inicialização", Default {
        disable {
          frame Enabled { }
          frame Disabled {
            Property Node(instance in=reference to "Deletar entre cursores", "Disabled"=TRUE)
            Property Node(instance in=reference to "Concatenar entre cursores", "Disabled"=TRUE)
            Property Node(instance in=reference to "Adquirir entre cursores", "Disabled"=TRUE)
          }
        }
        Property Node(instance in=reference to "Waveform Graph_2", "ActiveCursor"=0, "ActiveCursor"=1) -> ("Cursor"=w9, "Cursor"=w10)
        Property Node(instance in=w9, "Visible"=FALSE)
        w11 = "Esperar por evento"  # Type
        Property Node(instance in=w10, "Visible"=FALSE)
        w5 = s2
        w6 = w11
        w7 = s4
        w8 = s3
      }
      frame "Esperar por evento" {
        event {
          on "Amplitude" Value changed; "Fase" Value changed; "Forma de onda" Value changed; "Frequência" Value changed; "Offset" Value changed; "Razão cíclica" Value changed; "Tempo" Value changed {
            call "Conversor ENUM para ARRAY.gviweb"(Forma de onda=$"Forma de onda", Error in=s3) -> (Sinal=w12, Error out=w8)
            Property Node(instance in=s2, "Tempo"=$Tempo, "Amplitude"=$Amplitude, "Fase"=$Fase, "Offset"=$Offset, "Frequência"=$Frequência, "Razão cíclica"=$"Razão cíclica", "Sinal"=w12) -> (instance out=w5)
            w13 = "Simular onda"  # States
            w6 = w13
            w7 = s4
          }
          on "Adquirir entre cursores" Value changed; "Concatenar" Value changed; "Concatenar entre cursores" Value changed; "Deletar entre cursores" Value changed {
            Build Array($Concatenar, $"Concatenar entre cursores", $"Adquirir entre cursores", $"Deletar entre cursores") -> w14
            Boolean Array To Number(Boolean array=w14) -> (number=w15)
            call "Function_2.gviweb"(Input=reference to "Waveform Graph_2", Input_2=s3) -> (Posição cursor 0=w16, Posição cursor 1=w17, Output=w8)
            Property Node(instance in=s2, "Comando de edição"=w15, "Posição cursor 0"=w16, "Posição cursor 1"=w17) -> (instance out=w5)
            w18 = "Editar onda"  # Type
            w6 = w18
            w7 = default
          }
        }
      }
      frame "Simular onda" {
        Concatenate Strings("http://brsaolt-514zhif:9090/Gerador_WebService/", "SimularOnda") -> w19
        Property Node(instance in=s2) -> ("Sinal"=w20, "Tempo"=w21, "Offset"=w22, "Amplitude"=w23, "Fase"=w24, "Frequência"=w25, "Razão cíclica"=w26)
        w27 = "?Sinal=%s&Tempo=%.2f&Offset=%.2f&Amplitude=%.2f&Fase=%.2f&Frequencia=%.2f&RazaoCiclica=%.2f"
        Format Into String(formatString=w27, initString=w19, errIn=s3, w20, w21, w22, w23, w24, w25, w26) -> (outString=w28, errOut=w29)
        $"String Constant" <- w28
        w30 = "Esperar por evento"  # Type
        call "GET.gvi"(client handle=s4, url=w28, error in=w29) -> (client handle out=w7, body=w31, error out=w32)
        Unflatten From Json(JSON string=w31, error in (no error)=w32, type and defaults=cluster{"Y": f64[], "dt": f64} {all zero or empty}) -> (error out=w8, value=w33)
        Property Node(instance in=w33) -> ("Y"=w34, "dt"=w35)
        Build Waveform Node(Y=w34, dt=w35) -> (output waveform=w36)
        $"Waveform Graph" <- w36
        w5 = s2
        w6 = w30
      }
      frame "Posicionar cursores" {
        call "Posição cursores.gviweb"(graph in=reference to "Waveform Graph_2", Error In=s3) -> (Error Out=w8)
        $"error out" <- w8
        w37 = "Esperar por evento"  # Type
        w5 = s2
        w6 = w37
        w7 = s4
      }
      frame "Editar onda" {
        Property Node(instance in=s2) -> ("Comando de edição"=w38, "Posição cursor 0"=w39, "Posição cursor 1"=w40, instance out=w5)
        $"Comando de edição" <- w38
        Concatenate Strings("http://brsaolt-514zhif:9090/Gerador_WebService/", "EditarOnda") -> w41
        Format Into String(formatString="?Edicao=%d&Cursor0=%.2f&Cursor1=%.2f", initString=w41, errIn=s3, w38, w39, w40) -> (outString=w42, errOut=w43)
        call "GET.gvi"(client handle=s4, url=w42, error in=w43) -> (client handle out=w7, body=w44, error out=w45)
        Unflatten From Json(JSON string=w44, error in (no error)=w45, type and defaults=cluster{"Y": f64[], "dt": f64} {all zero or empty}) -> (error out=w8, value=w46)
        $value <- w46
        w47 = "Posicionar cursores"  # Type
        $"resulting string" <- w42
        Property Node(instance in=w46) -> ("Y"=w48, "dt"=w49)
        Build Waveform Node(Y=w48, dt=w49) -> (output waveform=w50)
        $"Waveform Graph_2" <- w50
        w6 = w47
      }
    }
    Wait(time to wait=50)
    next s1 = w6
    next s2 = w5
    next s3 = w8
    next s4 = w7
    stop if FALSE
  }
  call "Close HTTP Handle.gvi"(client handle=s4, error in=s3)
