vi "Gerador de sinais.gviweb"   [LabVIEW NXG 5.0.0]
panel controls:
  "Gerar onda": bool
panel indicators:
  "output waveform": waveform<f64>
  "URL Image": string
  "URL Image_2": string
diagram:
  while {
    case ($"Gerar onda") {
      frame False, Default {
        w1 = waveform<f64> {dt=1, Y=[]}
      }
      frame True {
        for (N = 5) {
          Initialize Array(element=0, size=10) -> w3
          Initialize Array(element=1, size=10) -> w4
          Build Array(w3, w4) -> w5
          concatenate w5 onto w2
        }
        Build Waveform Node(Y=w2, dt=0.1) -> (output waveform=w1)
      }
    }
    $"output waveform" <- w1
    Wait(time to wait=50)
    stop if FALSE
  }
